# Grasshopper definition Lazy item selector.gh (Grasshopper 1.0.7)

populate_3d = Populate3D(Region={Plane=PlaneXY(0, 0, 0), X=Domain(0, 10), Y=Domain(0, 10), Z=Domain(0, 2)}, Count=100, Seed=1)
select_item = CSharpScript(List=populate_3d, Index=Slider(0, range=0..99))  # -> out, Item; inputs List: list, Index: Int32
# ---------- select_item: C# ----------
    // This code were inspired from the discussion in:
    //https://www.grasshopper3d.com/forum/topics/change-number-slider-parameter-using-python?id=2985220%3ATopic%3A630153&page=1#comments
    
    List<System.Object> lst = new List<System.Object>();

    //Checking if the list is connected to the input
    if (List.Count != 0)
    {

      // Check to see if there is no slider, to add the slider
      if (lst.Count == 0 && this.Component.Params.Input[1].SourceCount == 0)
      {
        lst = List;
        Grasshopper.Kernel.Special.GH_NumberSlider slid = new Grasshopper.Kernel.Special.GH_NumberSlider();

        //Sets up default values, to makes sure that slider wouldn't cause crash
        slid.CreateAttributes();

        //slider position in grasshopper canvas
        slid.Attributes.Pivot = new System.Drawing.PointF((float) this.Component.Attributes.DocObject.Attributes.Bounds.Left -
          slid.Attributes.Bounds.Width - 50, this.Component.Attributes.DocObject.Attributes.Bounds.Bottom);


        // This command adds the slider to the grasshopper canvas
        GrasshopperDocument.AddObject(slid, false);

        //Connecting the new added slider to this component
        this.Component.Params.Input[1].AddSource(slid);

        //Changing the slider bounds to match the list length
        Grasshopper.Kernel.Special.GH_NumberSlider sld = (Grasshopper.Kernel.Special.GH_NumberSlider) this.Component.Params.Input[1].Sources[0];
        sld.Slider.Maximum = List.Count - 1;
        sld.Slider.Minimum = 0;
        sld.Slider.DecimalPlaces = 0;

        //Reseting the component so it reads the new input slider
        Component.ExpireSolution(true);
      }

      // Cheking if the list length has changed to change the bound
      if (lst.Count != List.Count)
      {
        lst = List;
        Grasshopper.Kernel.Special.GH_NumberSlider sld = (Grasshopper.Kernel.Special.GH_NumberSlider) this.Component.Params.Input[1].Sources[0];
        sld.Slider.Maximum = List.Count - 1;
        if (sld.Slider.Value > List.Count - 1)
        {
          sld.Slider.Value = 0;
        }
      }

      Item = List[Index];

    }
# ---------- end select_item ----------
panel = Panel(select_item.Item)
